# Grasshopper definition assembled_speckle.gh (Grasshopper 1.0.7)
# plug-ins: eleFront, Speckle 2, treesloth01, Pufferfish, Rhino.Inside for Autodesk Revit, CORE.Toolbox.Grasshopper

# ---- group: BIMSC-PROJECT
# Send a message to James M. to add
# new materials. This list will be updated
# for all groups to have a common material
# library and common material names.
panel = Panel("ELEMENTAL MARS")
bimsc_project = Text(panel)

# ---- group: RECEIVE MATERIALS
# RECIEVE
# MATERIALS
panel_2 = Panel("https://macad.speckle.xyz/projects/4975f9f0a8/models/d59a568f9e")
receive = Receive(
    Stream=panel_2,
    AutoReceive=False,
    CurrentComponentState="expired",
    ExpandOutput=True,
    LastInfoMessage="James McBennett @ 03/02/2024 01:57:29: Materials 01-03-2024 (id:6ecf38526e)",
    ReceiveOnOpen=False,
    ReceivedCommitId="6ecf38526e",
    StreamWrapper="https://macad.speckle.xyz/streams/4975f9f0a8/branches/d59a568f9e",
    selectedKitName="Objects")  # -> Info, Materials
dso = DeconstructSpeckleObject(SpeckleObject=receive.Materials, selectedKitName="Objects")  # -> Inflatable, Insulation, Regolith, Soil, Steel

# ---- group: FLOOR_LEVELS
# Set your 'Project' name, your 'Group'
# number, your 'Volume' Location that
# connect wirelessly.
series = Series(Start=0, Step=1, Count="5")
expression = Expression(x=series, Expression="Format(\"{0:00}\", x)")
concat = Concatenate(FragmentA="L", FragmentB=expression)  # -> simplify(graft(Result))
floor_levels = Text(concat)

# ----
# filter terrain
# add actual units
panel_3 = Panel("TopoBrep")  # disabled
panel_4 = Panel("Contours")  # disabled
panel_5 = Panel("TopoMesh")  # disabled
panel_6 = Panel("BakedStudioMarsTopoMain")  # disabled
list = ValueList({"AngularDimension", "Arc", "Block", "Brep", "Circle", "Curve", "Dimension", "Ellipse", "Extrusion", "Hatch", "Leader", "Line", "LinearDimension", "Mesh", "Point", "Polyline", "Polysurface", "RadialDimension", "Surface", "Text", "TextDot"}, selected="Mesh")  # disabled
reflay = ReferenceByLayer(LayerName=panel_4, lightweight=False)  # disabled
reflay_2 = ReferenceByLayer(LayerName=panel_3, lightweight=False)  # disabled
reflay_3 = ReferenceByLayer(LayerName=panel_5, lightweight=False)  # disabled
reflay_4 = ReferenceByLayer(LayerName=panel_6, lightweight=False)  # disabled
mesh = MeshBrep(
    Brep=reflay_2,
    Settings={GridMaxCount=0, GridMinCount=16, JaggedSeams=False, MaxEdgeLength=0, MinEdgeLength=0.0001, MinTolerance=0, Refine=True, RefineAngle=0, RelativeTolerance=0.65, SimplePlanes=True, Tolerance=0})  # disabled
filtertype = FilterByType(ObjectType=list, Geometry=reflay_4, invertFilter=False, returnNulls=False)  # -> ExcludedGeometry, IncludedGeometry; disabled
brep = Brep(reflay_2)  # disabled
mesh_2 = Mesh(reflay_3)  # disabled
faceb = FaceBoundaries(Mesh=mesh_2)  # disabled
mesh_3 = Mesh(filtertype.IncludedGeometry)  # disabled
faceb_2 = FaceBoundaries(Mesh=mesh_3)  # disabled
boundary = BoundarySurfaces(Edges=faceb)  # disabled
boundary_2 = BoundarySurfaces(Edges=faceb_2)  # disabled
join = BrepJoin(Breps=boundary)  # -> Breps, Closed; disabled
join_2 = BrepJoin(Breps=boundary_2)  # -> Breps, Closed; disabled

# ---- group: BIMSC-ORIGINATOR
bimsc_originator = Text("G06")

# ---- group: WorksForBrepsAndMeshes
list_2 = ValueList({"Srf/Brep": 0, "Mesh": 1}, selected="Mesh")

# ---- group: BIMSC-VOLUME
bimsc_volume = Text("A4")

# ----
# UNITS
panel_7 = Panel("UnitsRawVolumes")
reflay_5 = ReferenceByLayer(LayerName=panel_7, lightweight=False)
volume = Volume(Geometry=reflay_5)  # -> Volume, Centroid
int = Integer(volume.Volume)
cset = CreateSet(List=int)  # -> Set, Map
cset_2 = CreateSet(List=cset.Map)  # -> Set, Map
mindex = MemberIndex(Set=cset.Map, Member=cset_2.Set)  # -> Index, Count
item = ListItem(List=reflay_5, Index=mindex.Index, Wrap=True)  # -> simplify(Item)
bang = ExplodeTree(Data=item)  # -> Branch0, Branch1
item_2 = ListItem(List=bang.Branch0, Index=0, Wrap=True)

volume_2 = Volume(Geometry=bang.Branch0)  # -> Volume, Centroid
group = Group()
group_2 = Group()
group_3 = Group()

area = Area(Geometry=bang.Branch1)  # -> Area, Centroid
prox = Proximity3D(Points=area.Centroid, Group="1", MaxRadius="5")  # -> simplify(Links), Topology
clean = CleanTree(RemoveNulls=True, RemoveInvalid=True, RemoveEmpty=True, Tree=prox.Links)
dup_lines = CleanDuplicateLines(Lines=flatten(clean), Tolerance=0.01)  # -> Lines, Indices, Status
tstat = TreeStatistics(Tree=clean)  # -> Paths, Length, Count
split = SplitTree(Data=simplify(graft(bang.Branch1)), Masks=flatten(tstat.Paths))  # -> flatten(Positive), flatten(Negative)
dispatch = Dispatch(List=flatten(split.Positive), DispatchPattern=dup_lines.Status)  # -> ListA, ListB
item_3 = ListItem(List=split.Negative, Index="0", Wrap=True)

brep_2 = Brep(split.Negative)
volume_3 = Volume(Geometry=brep_2)  # -> Volume, Centroid
cull_i = CullIndex(List=volume_3.Centroid, Indices="0", Wrap=True)

# ---- group: units centroids
pt = Point(volume_3.Centroid)

# ----
group_4 = Group(Objects=flatten([group, group_2]))

# ---- group: units centroids
pt_2 = Point(volume_2.Centroid)  # disabled

# ----
group_5 = Group()  # disabled
group_6 = Group()  # disabled

dispatch_2 = Dispatch(List=flatten(clean), DispatchPattern=dup_lines.Status)  # -> graft(ListA), ListB
renumber = RenumberPaths(Data=dispatch_2.ListA)
end = EndPoints(Curve=renumber)  # -> Start, End
pdecon = Deconstruct(Point=[end.Start, end.End])  # -> XComponent, YComponent, ZComponent
int_2 = Integer(pdecon.ZComponent)
bnd = Bounds(Numbers=int_2)
dedomain = DeconstructDomain(Domain=bnd)  # -> Start, End
equals = Equality(FirstNumber=int_2, SecondNumber=dedomain.Start)  # -> Equality, Inequality
subtraction = Subtraction(A=dedomain.Start, B=dedomain.End)
cull = CullPattern(List=[end.Start, end.End], CullPattern=equals.Equality)
division = Division(A=subtraction, B="2")
abs = Absolute(Value=subtraction)
Z = UnitZ(Factor=division)
wires = BrepWireframe(Brep=dispatch.ListA, Density=-1)
move = Move(Geometry=cull, Motion=Z)  # -> Geometry, Transform
project = Project(Geometry=wires, Plane=move.Geometry)  # -> simplify(Geometry), Transform

end_2 = EndPoints(Curve=project.Geometry)  # -> Start, End
multiplication = Multiplication(A=abs, B="2")
cullpt = CullDuplicates(Points=[end_2.Start, end_2.End], Tolerance=0.1, CullMode=3)  # -> Points, Indices, Valence
pline = PolyLine(Vertices=cullpt.Points, Closed=True)  # -> simplify(Polyline)
Z_2 = UnitZ(Factor=multiplication)
extr = Extrude(Base=pline, Direction=Z_2)
cap = CapHoles(Brep=extr)

# ---- group: Units_Buffer
debrep = DeconstructBrep(Brep=bang.Branch0)  # -> Faces, Edges, Vertices
area_2 = Area(Geometry=debrep.Faces)  # -> Area, Centroid
pdecon_2 = Deconstruct(Point=area_2.Centroid)  # -> XComponent, YComponent, ZComponent
int_3 = Integer(pdecon_2.ZComponent)
bnd_2 = Bounds(Numbers=int_3)
dedomain_2 = DeconstructDomain(Domain=bnd_2)  # -> Start, End
equals_2 = Equality(FirstNumber=int_3, SecondNumber=dedomain_2.Start)  # -> Equality, Inequality
cull_2 = CullPattern(List=area_2.Centroid, CullPattern=equals_2.Equality)  # -> simplify(List)
pln = Plane(flatten(cull_2))

# ---- group: Units_Support
debrep_2 = DeconstructBrep(Brep=cap)  # -> Faces, Edges, Vertices
area_3 = Area(Geometry=debrep_2.Faces)  # -> Area, Centroid
pdecon_3 = Deconstruct(Point=area_3.Centroid)  # -> XComponent, YComponent, ZComponent
int_4 = Integer(pdecon_3.ZComponent)
bnd_3 = Bounds(Numbers=int_4)
dedomain_3 = DeconstructDomain(Domain=bnd_3)  # -> Start, End
equals_3 = Equality(FirstNumber=int_4, SecondNumber=dedomain_3.Start)  # -> Equality, Inequality
cull_3 = CullPattern(List=area_3.Centroid, CullPattern=equals_3.Equality)  # -> simplify(List)
pln_2 = Plane(flatten(cull_3))

# ---- group: Units_Habi
debrep_3 = DeconstructBrep(Brep=bang.Branch0)  # -> Faces, Edges, Vertices
area_4 = Area(Geometry=debrep_3.Faces)  # -> Area, Centroid
pdecon_4 = Deconstruct(Point=area_4.Centroid)  # -> XComponent, YComponent, ZComponent
int_5 = Integer(pdecon_4.ZComponent)
bnd_4 = Bounds(Numbers=int_5)
dedomain_4 = DeconstructDomain(Domain=bnd_4)  # -> Start, End
equals_4 = Equality(FirstNumber=int_5, SecondNumber=dedomain_4.Start)  # -> Equality, Inequality
cull_4 = CullPattern(List=area_4.Centroid, CullPattern=equals_4.Equality)  # -> simplify(List)
pln_3 = Plane(flatten(cull_4))

# ----
# 01 //Create Revit Materials from Rhino M Properties
trigger = Trigger(Interval=-1000, TimerInterval=1000, Target=[material, graphics])

# ----
# 02// Create New Unit Revit Family
trigger_2 = Trigger(Interval=-1000, TimerInterval=1000, Target=[new, famform, materials, active])

# ----
# The figures in the circles from the trigger component
# for the revit families to work have to be from left to right:
# a triangle (play), a pointer (mouse), and a key.
# //Send Topo Meshes to Revit
trigger_3 = Trigger(Interval=-1000, TimerInterval=1000, Target=topography)

# ----
# 03//Add Units to Revit
trigger_4 = Trigger(Interval=-1000, TimerInterval=1000, Target=[types, l_component])

# ---- group: Units_Buffer
brep_3 = Brep(Tree({0}: [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], {1}: [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]))

# ---- group: Units_Habi
brep_4 = Brep(Tree({0}: [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], {1}: [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]))

# ---- group: Units_Support
brep_5 = Brep(Tree({0}: [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], {1}: [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]))

# ----
# //Send block instances to Revit
listblockd = ListBlocksInDocument(fullName=True)
refblock = ReferenceBlockByName(BlockName=listblockd, getNestedBlocks=False, lightweight=False, DisableAutoUpdate=False)
item_4 = ListItem(List=refblock, Index=0, Wrap=True)
block_info = GetBlockInfo(Block=item_4)  # -> Name, Plane, Transform, BlockType, FilePath, Active
orient = Orient(Geometry=item_4, Source=block_info.Plane, Target=PlaneXY(0, 0, 0))  # -> Geometry, Transform
expblock = ExplodeBlock(Block=orient.Geometry, recursive=False)  # -> Name, Transform, Geometry

# ----
# //Query materials' names using Elefront
geo = Geometry(expblock.Geometry)
ef_att = EleFrontAttributes(Attributes=geo)
ef_layer = EleFrontLayer(Layer=ef_att)
ef_layer_2 = EleFrontLayer(Layer=ef_layer)

block_info_2 = GetBlockInfo(Block=refblock)  # -> Name, Plane, Transform, BlockType, FilePath, Active
stack = StackTrees(Data0=pln, Data1=pln_3, Data2=pln_2, Reduce=True)

split_2 = TextSplit(Text=ef_layer, Separators="::")
item_5 = ListItem(List=split_2, Index=-1, Wrap=True)
concat_2 = Concatenate(FragmentA="M-", FragmentB=item_5)  # -> simplify(Result)
pshift = ShiftPaths(Data=concat_2, Offset=-1)

# ----
# 02// Create new component family
add_link_to_revit_family_in_from_your_la = Panel("C:\Users\ARoncal\OneDrive - Thornton Tomasetti, Inc\__License Resources\Desktop\G06_studio_2024\Final\documentation\FTemplate_GEN_.rft")  # "Add Link to Revit Family in from your laptop. [Final / Documentation]"
materials = QueryMaterials(Name=pshift)
famform = ComponentFamilyForm(Brep=graft(geo), Material=materials)
active = ActiveDocument()
shift = ShiftPaths(Data=famform, Offset=-1)
new = NewComponentFamily(
    Document=active,
    Template=add_link_to_revit_family_in_from_your_la,
    Overwrite=Toggle(True),
    Name=simplify(expblock.Name),
    Geometry=simplify(shift))

# ----
# 03//Add components to RH Planes
types = QueryTypes(Document=active, Kind=3, FamilyName=expblock.Name)
move2pt = MoveToPoint(Geometry=block_info_2.Plane, PointA=block_info_2.Plane, PointB=stack)  # -> Moved, Vector, Transform
l_component = AddComponentLocation(Document=active, Location=simplify(stack), Type=simplify(types), TrackingMode=2)

# ----
# Phasing
number_slider = Slider(7, range=1..7)  # disabled
series_2 = Series(Start=1, Step=1, Count=number_slider)  # disabled
item_6 = ListItem(List=series_2, Index=0, Wrap=True)  # -> Item, Item1, Item2, Item3, Item4, Item5, Item6; disabled

# ---- group: PHASE
num = Number(item_6.Item3)  # disabled

num_2 = Number(item_6.Item2)  # disabled

num_3 = Number(item_6.Item1)  # disabled

# PHASE 1 - NO HUMANS
# EDIT SITE MESH
num_4 = Number(item_6.Item)  # disabled

num_5 = Number(item_6.Item4)  # disabled

num_6 = Number(item_6.Item5)  # disabled

# PHASE 2 - HUMANS / MACHINE COLLABORATION
num_7 = Number(item_6.Item6)  # disabled

# ----
# WALLS
panel_8 = Panel("Wall")
reflay_6 = ReferenceByLayer(LayerName=panel_8, lightweight=False, DisableAutoUpdate=False)
panel_9 = Panel(reflay_6)
mesh_4 = MeshBrep(
    Brep=reflay_6,
    Settings={GridMaxCount=0, GridMinCount=16, JaggedSeams=False, MaxEdgeLength=0, MinEdgeLength=0.0001, MinTolerance=0, Refine=True, RefineAngle=0, RelativeTolerance=0.65, SimplePlanes=True, Tolerance=0})
brep_6 = Brep(reflay_6)
mjoin = MeshJoin(Meshes=mesh_4)
weld = WeldMesh(Mesh=mjoin, Angle=3.141592654)

panel_10 = Panel("https://macad.speckle.xyz/streams/4975f9f0a8/branches/site/04-community-site")
receive_2 = Receive(
    Stream=panel_10,
    AutoReceive=False,
    CurrentComponentState="expired",
    ExpandOutput=True,
    LastInfoMessage="James McBennett @ 03/01/2024 23:14:17: 2024 Mar-01 (id:9ec35295b2)",
    ReceiveOnOpen=False,
    ReceivedCommitId="9ec35295b2",
    StreamWrapper="https://macad.speckle.xyz/streams/4975f9f0a8/branches/site/04-community-site",
    selectedKitName="Objects")  # -> Info, CONTOURS, SOIL
item_7 = ListItem(List=flatten(receive_2.SOIL), Index=Slider(3, range=0..17), Wrap=True)
srf = Surface(<surface referenced from the Rhino model>)
bbox = BoundingBox(Content=srf, Plane=PlaneXY(0, 0, 0))  # -> Box, Box_2
volume_4 = Volume(Geometry=bbox.Box)  # -> Volume, Centroid
msphere = MeshSphere(Base=volume_4.Centroid, Radius="80", UCount="100", VCount="100")
mmx = MeshMesh(MeshA=item_7, MeshB=msphere)
msplit = MeshSplit(Mesh=item_7, Splitters=msphere)

# ----
# ROOFS
panel_11 = Panel("Roof")
reflay_7 = ReferenceByLayer(LayerName=panel_11, lightweight=False, DisableAutoUpdate=False)
panel_12 = Panel(reflay_7)
mesh_5 = Mesh(reflay_7)
faceb_3 = FaceBoundaries(Mesh=mesh_5)
boundary_3 = BoundarySurfaces(Edges=faceb_3)
join_3 = BrepJoin(Breps=boundary_3)  # -> Breps, Closed
mesh_6 = Mesh(reflay_7)

# ----
# TERRAIN
panel_13 = Panel("TopoMesh")
reflay_8 = ReferenceByLayer(LayerName=panel_13, lightweight=False, DisableAutoUpdate=False)
reflay_9 = ReferenceByLayer(LayerName="TopoBrep", lightweight=False, DisableAutoUpdate=False)
panel_14 = Panel([reflay_8, reflay_9])

# ----
# //Send topo meshes to Revit
number_slider_2 = Slider(9, range=0..10)
mesh_7 = Mesh(reflay_8)
unweld = UnweldMesh(Mesh=mesh_7, Angle=degrees(number_slider_2))
topography = AddTopographyMesh(Mesh=unweld, TrackingMode=2)  # disabled

# ----
# FLOORS
panel_15 = Panel("Floors")
reflay_10 = ReferenceByLayer(LayerName=panel_15, lightweight=False, DisableAutoUpdate=False)
panel_16 = Panel(reflay_10)
mesh_8 = MeshBrep(
    Brep=reflay_10,
    Settings={GridMaxCount=0, GridMinCount=16, JaggedSeams=False, MaxEdgeLength=0, MinEdgeLength=0.0001, MinTolerance=0, Refine=True, RefineAngle=0, RelativeTolerance=0.65, SimplePlanes=True, Tolerance=0})
brep_7 = Brep(reflay_10)
mjoin_2 = MeshJoin(Meshes=mesh_8)
weld_2 = WeldMesh(Mesh=mjoin_2, Angle=3.141592654)

reflay_11 = ReferenceByLayer(LayerName="Pods", lightweight=False, DisableAutoUpdate=False)
panel_17 = Panel(reflay_11)
mesh_9 = MeshBrep(
    Brep=reflay_11,
    Settings={GridMaxCount=0, GridMinCount=16, JaggedSeams=False, MaxEdgeLength=0, MinEdgeLength=0.0001, MinTolerance=0, Refine=True, RefineAngle=0, RelativeTolerance=0.65, SimplePlanes=True, Tolerance=0})
brep_8 = Brep(reflay_11)
mjoin_3 = MeshJoin(Meshes=mesh_9)
weld_3 = WeldMesh(Mesh=mjoin_3, Angle=3.141592654)

# ---- group: LEVEL
floor_levels_2 = Text(floor_levels)  # disabled

# ----
filter = StreamFilter(Gate=list_2, Stream0=reflay_9, Stream1=reflay_8)  # disabled
msplit_2 = MeshSplit(Mesh=filter, Splitters=msphere)  # disabled
number_slider_3 = Slider(1, range=0..1)  # disabled
item_8 = ListItem(List=msplit_2, Index=number_slider_3, Wrap=True)  # disabled
panel_18 = Panel("TERRAIN")  # disabled
panel_19 = Panel("soil")  # disabled
name = ExtendSpeckleObject(
    SpeckleObject=item_8,
    BIMSCPROJECT=bimsc_project,
    BIMSCORIGINATOR=bimsc_originator,
    BIMSCVOLUME=bimsc_volume,
    BIMSCLEVEL=floor_levels_2,
    BIMSCTYPE=panel_18,
    BIMSCMATERIAL=panel_19,
    RenderMaterial=dso.Soil,
    BIMSCPHASE=num_4,
    selectedKitName="Objects")  # -> flatten(ExtendedSpeckleObject); disabled

# ---- group: LEVEL
floor_levels_3 = Text(floor_levels)  # disabled

# ----
filter_2 = StreamFilter(Gate=list_2, Stream0=brep_7, Stream1=weld_2)  # disabled
panel_20 = Panel("FLOORS")  # disabled
panel_21 = Panel("Regolith")  # disabled
name_2 = ExtendSpeckleObject(
    SpeckleObject=filter_2,
    BIMSCPROJECT=bimsc_project,
    BIMSCORIGINATOR=bimsc_originator,
    BIMSCVOLUME=bimsc_volume,
    BIMSCLEVEL=floor_levels_3,
    BIMSCTYPE=panel_20,
    BIMSCMATERIAL=panel_21,
    RenderMaterial=dso.Regolith,
    BIMSCPHASE=num_3,
    selectedKitName="Objects")  # -> flatten(ExtendedSpeckleObject); disabled

# ---- group: LEVEL
floor_levels_4 = Text(floor_levels)  # disabled

# ----
filter_3 = StreamFilter(Gate=list_2, Stream0=brep_8, Stream1=weld_3)  # disabled
panel_22 = Panel("PODS")  # disabled
name_3 = ExtendSpeckleObject(
    SpeckleObject=filter_3,
    BIMSCPROJECT=bimsc_project,
    BIMSCORIGINATOR=bimsc_originator,
    BIMSCVOLUME=bimsc_volume,
    BIMSCLEVEL=floor_levels_4,
    BIMSCTYPE=panel_22,
    BIMSCMATERIAL=panel_21,
    RenderMaterial=dso.Regolith,
    BIMSCPHASE=num_2,
    selectedKitName="Objects")  # -> flatten(ExtendedSpeckleObject); disabled

# ---- group: LEVEL
floor_levels_5 = Text(floor_levels)  # disabled

floor_levels_6 = Text(floor_levels)  # disabled

txt = Text(Tree({0}: ["L00"], {1}: ["L04"]))  # disabled

# ----
filter_4 = StreamFilter(Gate=list_2, Stream0=join_3.Breps, Stream1=mesh_6)  # -> reverse(simplify(graft(Stream))); disabled
panel_23 = Panel("Inflatable")  # disabled
panel_24 = Panel("ROOF")  # disabled
name_4 = ExtendSpeckleObject(
    SpeckleObject=filter_4,
    BIMSCPROJECT=bimsc_project,
    BIMSCORIGINATOR=bimsc_originator,
    BIMSCVOLUME=bimsc_volume,
    BIMSCLEVEL=txt,
    BIMSCTYPE=panel_24,
    BIMSCMATERIAL=panel_23,
    RenderMaterial=dso.Inflatable,
    BIMSCPHASE=num_7,
    selectedKitName="Objects")  # disabled

# ---- group: LEVEL
txt_2 = Text(Tree({0}: ["L00"], {1}: ["L04"]))  # disabled

# ----
filter_5 = StreamFilter(Gate=list_2, Stream0=brep_6, Stream1=weld)  # -> reverse(simplify(graft(Stream))); disabled
panel_25 = Panel("WALLS")  # disabled
name_5 = ExtendSpeckleObject(
    SpeckleObject=filter_5,
    BIMSCPROJECT=bimsc_project,
    BIMSCORIGINATOR=bimsc_originator,
    BIMSCVOLUME=bimsc_volume,
    BIMSCLEVEL=txt_2,
    BIMSCTYPE=panel_25,
    BIMSCMATERIAL=panel_21,
    RenderMaterial=dso.Regolith,
    BIMSCPHASE=num_6,
    selectedKitName="Objects")  # disabled

# ---- group: LEVEL
floor_levels_7 = Text(floor_levels)  # disabled

# ----
number_slider_4 = Slider(0, range=0..1)  # disabled
item_9 = ListItem(List=msplit, Index=number_slider_4, Wrap=True)  # disabled
panel_26 = Panel("SITE")  # disabled
panel_27 = Panel("soil")  # disabled
name_6 = ExtendSpeckleObject(
    SpeckleObject=item_9,
    BIMSCPROJECT=bimsc_project,
    BIMSCORIGINATOR=bimsc_originator,
    BIMSCVOLUME=bimsc_volume,
    BIMSCLEVEL=floor_levels_7,
    BIMSCTYPE=panel_26,
    BIMSCMATERIAL=panel_27,
    RenderMaterial=dso.Soil,
    BIMSCPHASE=num_4,
    selectedKitName="Objects")  # -> flatten(ExtendedSpeckleObject); disabled

number_slider_5 = Slider(1.5, range=1..2)
range = Range(Domain=Slider(1.5, range=0..6.002), Steps=number_slider_5)
range_2 = Range(Domain=Domain(0, 1), Steps=number_slider_5)
graph = GraphMapper(range_2, x0=0, x1=1, y0=0, y1=1, container_name="Bezier", cpx=[0, 0.5185281634, 1, 1], cpy=[0, 0, 0.1436586976, 1])
pt_3 = ConstructPoint(XCoordinate=0, YCoordinate=0, ZCoordinate=range)
dom = ConstructDomain(DomainStart=Slider(2, range=1..13), DomainEnd=Slider(0.7, range=0..2.02))
bnd_5 = Bounds(Numbers=graph)
prot = RotatePlane(Plane=pt_3, Angle="0.5*pi")
remap = RemapNumbers(Value=graph, Source=bnd_5, Target=dom)  # -> Mapped, Clipped
cir = Circle(Plane=pt_3, Radius=remap.Mapped)
item_10 = ListItem(List=cir, Index=0, Wrap=True)
area_5 = Area(Geometry=item_10)  # -> Area, Centroid
number_slider_6 = Slider(0.01, range=0..1)
range_3 = Range(Domain=Domain(0, 1), Steps=Slider(4, range=0..50))
shatter = Shatter(Curve=reparameterize(graft(cir)), Parameters=range_3)
subtraction_2 = Subtraction(A="1", B=number_slider_6)
merge = Merge(Data1="0", Data2=number_slider_6, Data3=subtraction_2, Data4="1")
consec = ConsecutiveDomains(Numbers=merge, Additive=invert(True))
panel_28 = Panel(merge)
subcrv = SubCurve(BaseCurve=reparameterize(graft(shatter)), Domain=consec)
panel_29 = Panel("""0
2""")
panel_30 = Panel(consec)
cull_i_2 = CullIndex(List=subcrv, Indices=panel_29, Wrap=True)  # -> simplify(List)
item_11 = ListItem(List=subcrv, Index=panel_29, Wrap=True)
pshift_2 = ShiftPaths(Data=cull_i_2, Offset=-1)
flip = FlipMatrix(Data=pshift_2)
midpt = CurveMiddle(Curve=flip)
loft = Loft(Curves=cir, Options={Adjust=False, Closed=False, LoftEnds=0, LoftSimp=0, LoftType=0, Rebuild=10, Refit=0.01})
pshift_3 = ShiftPaths(Data=item_11, Offset=-1)
graph_2 = GraphMapper(range_2, x0=0, x1=1, y0=0, y1=1, container_name="Bezier", cpx=[0, 0.25, 0.75, 1], cpy=[0, 0.25, 0.75, 1])
join_4 = JoinCurves(Curves=pshift_3, Preserve=False)
brep_cp = BrepClosestPoint(Point=midpt, Brep=loft)  # -> Point, Normal, Distance
dom_2 = ConstructDomain(DomainStart=Slider(0.1, range=0..10), DomainEnd=Slider(0.11, range=0..1))
flip_2 = FlipMatrix(Data=join_4)
bnd_6 = Bounds(Numbers=graph_2)
remap_2 = RemapNumbers(Value=graph_2, Source=bnd_6, Target=dom_2)  # -> Mapped, Clipped
amp = Amplitude(Vector=brep_cp.Normal, Amplitude=remap_2.Mapped)
rev = Reverse(Vector=amp)
end_3 = EndPoints(Curve=flip)  # -> Start, End
move_2 = Move(Geometry=midpt, Motion=rev)  # -> Geometry, Transform
arc = Arc3Pt(PointA=end_3.Start, PointB=move_2.Geometry, PointC=end_3.End)  # -> Arc, Plane, Radius
item_12 = ListItem(List=arc.Arc, Index=0, Wrap=True)
project_2 = Project(Geometry=item_12, Plane=PlaneXY(0, 0, 0))  # -> Geometry, Transform
loft_opt = LoftOptions(Closed=False, Adjust=False, Rebuild=0, Refit="0.01", Type=0)
replace = ReplaceItems(List=arc.Arc, Item=project_2.Geometry, Indices="0", Wrap=False)
loft_2 = Loft(Curves=flip_2, Options=loft_opt)
loft_3 = Loft(Curves=replace, Options=loft_opt)
entwine = Entwine(Branch00=loft_3, Branch01=loft_2, FlattenInputs=True)
brep_9 = Brep(item_2)
merge_2 = Merge(Data1=ColourSwatch(SwatchColor=RGBA(107, 107, 107, 206)), Data2=ColourSwatch(SwatchColor=RGB(255, 255, 255)))  # -> simplify(graft(Result))
python = GhPythonScript(S=entwine, D=Slider(0.01, range=0..1))  # -> simplify(a); inputs S: Brep
# ---------- python: Python ----------
import rhinoscriptsyntax as rs

a = rs.OffsetSurface(S, D, None, False, True)
# ---------- end python ----------
flatten = FlattenTree(Tree=python, Path="{0}")

Z_3 = UnitZ(Factor=expr("-x", Slider(0.1, range=0..10)))
item_13 = ListItem(List=cir, Index="-1", Wrap=True)
extr_2 = Extrude(Base=item_13, Direction=Z_3)
cap_2 = CapHoles(Brep=extr_2)

item_14 = ListItem(List=brep_9, Index=0, Wrap=True)

volume_5 = Volume(Geometry=item_14)  # -> Volume, Centroid
move2pt_2 = MoveToPoint(Geometry=flatten, PointA=area_5.Centroid, PointB=graft(volume_5.Centroid))  # -> simplify(Moved), Vector, Transform
lng = ListLength(List=move2pt_2.Moved)
graft = GraftTree(Tree=volume_5.Centroid, IncludeEmptyLists=True, IncludeNullItems=True)  # -> simplify(Tree)
group_7 = Group(Objects=move2pt_2.Moved)
split_3 = SplitList(List=move2pt_2.Moved, Index=expr("x/2", lng))  # -> flatten(ListA), flatten(ListB)
mirror = Mirror(Geometry=group_7, Plane=graft)  # -> Geometry, Transform
ungroup = Ungroup(Group=mirror.Geometry)
move2pt_3 = MoveToPoint(Geometry=cap_2, PointA=area_5.Centroid, PointB=graft(volume_5.Centroid))  # -> Moved, Vector, Transform
split_4 = SplitList(List=ungroup, Index=expr("x/2", lng))  # -> flatten(ListA), flatten(ListB)
entwine_2 = Entwine(Branch00=split_3.ListA, Branch01=split_3.ListB, FlattenInputs=True)  # -> simplify(Result)
entwine_3 = Entwine(Branch00=split_4.ListA, Branch01=split_4.ListB, FlattenInputs=True)  # -> simplify(Result)
merge_3 = Merge(Data1=entwine_2, Data2=entwine_3)

data = Data([split_3.ListB, split_4.ListB])  # disabled
data_2 = Data([split_3.ListA, split_4.ListA])  # disabled
qrmesh = QuadRemesh(Mesh=data_2, Settings={aqc=True, as=50, dhe=True, gci=0, null=False, pme=0, sa=0, tqc=2000})  # -> graft(QuadResult); disabled
qrmesh_2 = QuadRemesh(Mesh=data, Settings={aqc=True, as=50, dhe=True, gci=0, null=False, pme=0, sa=0, tqc=2000})  # disabled

# ---- group: unit centroid
pt_4 = Point(volume_5.Centroid)  # disabled

# ----
group_8 = Group(Objects=qrmesh)  # disabled
group_9 = Group(Objects=qrmesh_2)  # disabled
group_10 = Group(Objects=flatten([group_9, group_5]))  # disabled
move2pt_4 = MoveToPoint(Geometry=move2pt_3.Moved, PointA=pt_4, PointB=pt_2)  # -> flatten(Moved), Vector, Transform; disabled
move2pt_5 = MoveToPoint(Geometry=qrmesh_2, PointA=pt_4, PointB=graft(pt_2))  # -> flatten(Moved), Vector, Transform; disabled
move2pt_6 = MoveToPoint(Geometry=qrmesh, PointA=pt_4, PointB=pt_2)  # -> flatten(Moved), Vector, Transform; disabled
merge_4 = Merge(Data1=move2pt_4.Moved, Data2=move2pt_5.Moved)  # disabled

number_slider_7 = Slider(1.5, range=1..2)
range_4 = Range(Domain=Slider(1.5, range=0..6.002), Steps=number_slider_7)
range_5 = Range(Domain=Domain(0, 1), Steps=number_slider_7)
graph_3 = GraphMapper(range_5, x0=0, x1=1, y0=0, y1=1, container_name="Bezier", cpx=[0, 0.5185281634, 1, 1], cpy=[0, 0, 0.1436586976, 1])
pt_5 = ConstructPoint(XCoordinate=0, YCoordinate=0, ZCoordinate=range_4)
dom_3 = ConstructDomain(DomainStart=Slider(3.9, range=1..13), DomainEnd=Slider(1.2, range=0..2.02))
bnd_7 = Bounds(Numbers=graph_3)
prot_2 = RotatePlane(Plane=pt_5, Angle="0.5*pi")
remap_3 = RemapNumbers(Value=graph_3, Source=bnd_7, Target=dom_3)  # -> Mapped, Clipped
number_slider_8 = Slider(0.01, range=0..1)
cir_2 = Circle(Plane=prot_2, Radius=remap_3.Mapped)
item_15 = ListItem(List=cir_2, Index=0, Wrap=True)
area_6 = Area(Geometry=item_15)  # -> Area, Centroid
subtraction_3 = Subtraction(A="1", B=number_slider_8)
range_6 = Range(Domain=Domain(0, 1), Steps=Slider(8, range=0..50))
merge_5 = Merge(Data1="0", Data2=number_slider_8, Data3=subtraction_3, Data4="1")
shatter_2 = Shatter(Curve=reparameterize(graft(cir_2)), Parameters=range_6)
consec_2 = ConsecutiveDomains(Numbers=merge_5, Additive=invert(True))
panel_31 = Panel(merge_5)
subcrv_2 = SubCurve(BaseCurve=reparameterize(graft(shatter_2)), Domain=consec_2)
panel_32 = Panel("""0
2""")
panel_33 = Panel(consec_2)
cull_i_3 = CullIndex(List=subcrv_2, Indices=panel_32, Wrap=True)  # -> simplify(List)
item_16 = ListItem(List=subcrv_2, Index=panel_32, Wrap=True)
pshift_4 = ShiftPaths(Data=cull_i_3, Offset=-1)
flip_3 = FlipMatrix(Data=pshift_4)
midpt_2 = CurveMiddle(Curve=flip_3)
loft_4 = Loft(Curves=cir_2, Options={Adjust=False, Closed=False, LoftEnds=0, LoftSimp=0, LoftType=0, Rebuild=10, Refit=0.01})
pshift_5 = ShiftPaths(Data=item_16, Offset=-1)
graph_4 = GraphMapper(range_5, x0=0, x1=1, y0=0, y1=1, container_name="Bezier", cpx=[0, 0.25, 0.75, 1], cpy=[0, 0.25, 0.75, 1])
join_5 = JoinCurves(Curves=pshift_5, Preserve=False)
brep_cp_2 = BrepClosestPoint(Point=midpt_2, Brep=loft_4)  # -> Point, Normal, Distance
dom_4 = ConstructDomain(DomainStart=Slider(0.1, range=0..10), DomainEnd=Slider(0.11, range=0..1))
flip_4 = FlipMatrix(Data=join_5)
bnd_8 = Bounds(Numbers=graph_4)
remap_4 = RemapNumbers(Value=graph_4, Source=bnd_8, Target=dom_4)  # -> Mapped, Clipped
amp_2 = Amplitude(Vector=brep_cp_2.Normal, Amplitude=remap_4.Mapped)
rev_2 = Reverse(Vector=amp_2)
end_4 = EndPoints(Curve=flip_3)  # -> Start, End
move_3 = Move(Geometry=midpt_2, Motion=rev_2)  # -> Geometry, Transform
arc_2 = Arc3Pt(PointA=end_4.Start, PointB=move_3.Geometry, PointC=end_4.End)  # -> Arc, Plane, Radius
item_17 = ListItem(List=arc_2.Arc, Index=0, Wrap=True)
project_3 = Project(Geometry=item_17, Plane=PlaneXY(0, 0, 0))  # -> Geometry, Transform
loft_opt_2 = LoftOptions(Closed=False, Adjust=False, Rebuild=0, Refit="0.01", Type=0)
replace_2 = ReplaceItems(List=arc_2.Arc, Item=project_3.Geometry, Indices="0", Wrap=False)
loft_5 = Loft(Curves=flip_4, Options=loft_opt_2)
loft_6 = Loft(Curves=replace_2, Options=loft_opt_2)
entwine_4 = Entwine(Branch00=loft_6, Branch01=loft_5, FlattenInputs=True)
merge_6 = Merge(Data1=ColourSwatch(SwatchColor=RGBA(189, 189, 189, 206)), Data2=ColourSwatch(SwatchColor=RGB(255, 255, 255)))  # -> simplify(graft(Result))
python_2 = GhPythonScript(S=entwine_4, D=Slider(0.01, range=0..1))  # -> simplify(a); inputs S: Brep; same code as python
brep_10 = Brep(item_3)
volume_6 = Volume(Geometry=brep_10)  # -> Volume, Centroid
flatten_2 = FlattenTree(Tree=python_2, Path="{0}")
move2pt_7 = MoveToPoint(Geometry=flatten_2, PointA=area_6.Centroid, PointB=graft(volume_6.Centroid))  # -> simplify(Moved), Vector, Transform
lng_2 = ListLength(List=move2pt_7.Moved)
graft_2 = GraftTree(Tree=volume_6.Centroid, IncludeEmptyLists=True, IncludeNullItems=True)  # -> simplify(Tree)
group_11 = Group(Objects=move2pt_7.Moved)
split_5 = SplitList(List=move2pt_7.Moved, Index=expr("x/2", lng_2))  # -> flatten(ListA), flatten(ListB)
mirror_2 = Mirror(Geometry=group_11, Plane=graft_2)  # -> Geometry, Transform
ungroup_2 = Ungroup(Group=mirror_2.Geometry)
entwine_5 = Entwine(Branch00=split_5.ListA, Branch01=split_5.ListB, FlattenInputs=True)  # -> simplify(Result)
split_6 = SplitList(List=ungroup_2, Index=expr("x/2", lng_2))  # -> flatten(ListA), flatten(ListB)
entwine_6 = Entwine(Branch00=split_6.ListA, Branch01=split_6.ListB, FlattenInputs=True)  # -> simplify(Result)
merge_7 = Merge(Data1=entwine_5, Data2=entwine_6)

Z_4 = UnitZ(Factor=expr("-x", Slider(0.1, range=0..10)))
item_18 = ListItem(List=cir_2, Index="-1", Wrap=True)
extr_3 = Extrude(Base=item_18, Direction=Z_4)
cap_3 = CapHoles(Brep=extr_3)

move2pt_8 = MoveToPoint(Geometry=cap_3, PointA=area_6.Centroid, PointB=graft(volume_6.Centroid))  # -> Moved, Vector, Transform

data_3 = Data([split_5.ListB, split_6.ListB])
data_4 = Data([split_5.ListA, split_6.ListA])

# ---- group: unit centroid
pt_6 = Point(volume_6.Centroid)

# ----
debrep_4 = DeconstructBrep(Brep=brep_10)  # -> Faces, Edges, Vertices; disabled
area_7 = Area(Geometry=debrep_4.Faces)  # -> Area, Centroid; disabled
panel_34 = Panel("""0
3""")  # disabled
item_19 = ListItem(List=flatten(area_7.Centroid), Index=panel_34, Wrap=True)  # disabled
panel_35 = Panel("22.5")  # disabled
rotate = Rotate(Geometry=item_19, Angle=degrees(panel_35), Plane=pt_6)  # -> Geometry, Transform; disabled
number_slider_9 = Slider(2, range=0..10)  # disabled
number_slider_10 = Slider(0, range=0..10)  # disabled
ln = Line(StartPoint=rotate.Geometry, EndPoint=pt_6)  # disabled
ext = ExtendCurve(Curve=ln, Type=0, Start=number_slider_9, End=number_slider_10)  # disabled
panel_36 = Panel("0.5")  # disabled
number_slider_11 = Slider(0.7, range=0..1)  # disabled
pframe = PerpFrame(Curve=reparameterize(ext), Parameter=panel_36)  # -> graft(Frame); disabled
pipe = Pipe(Curve=ext, Radius=1, Caps=0)  # disabled
scale_nu = ScaleNU(Geometry=pipe, Plane=pframe, ScaleX=1, ScaleY=number_slider_11, ScaleZ=1)  # -> Geometry, Transform; disabled
panel_37 = Panel(pframe)  # disabled
cap_4 = CapHoles(Brep=scale_nu.Geometry)  # disabled
mesh_10 = Mesh(cap_4)  # disabled
number_slider_12 = Slider(0, range=0..100)  # disabled
msplit_3 = MeshSplit(Splitters=flatten(mesh_10))  # disabled
item_20 = ListItem(List=msplit_3, Index=number_slider_12, Wrap=True)  # disabled

move2pt_9 = MoveToPoint(Geometry=data_3, PointA=pt_6, PointB=graft(pt))  # -> flatten(Moved), Vector, Transform
move2pt_10 = MoveToPoint(Geometry=data_4, PointA=pt_6, PointB=pt)  # -> flatten(Moved), Vector, Transform
move2pt_11 = MoveToPoint(PointA=pt_6, PointB=pt)  # -> flatten(Moved), Vector, Transform
merge_8 = Merge(Data1=move2pt_10.Moved, Data2=move2pt_9.Moved)

number_slider_13 = Slider(1.5, range=1..2)
range_7 = Range(Domain=Slider(3.7, range=0..6.002), Steps=number_slider_13)
range_8 = Range(Domain=Domain(0, 1), Steps=number_slider_13)
graph_5 = GraphMapper(range_8, x0=0, x1=1, y0=0, y1=1, container_name="Bezier", cpx=[0, 0.5185281634, 1, 1], cpy=[0, 0, 0.1436586976, 1])
pt_7 = ConstructPoint(XCoordinate=0, YCoordinate=0, ZCoordinate=range_7)
dom_5 = ConstructDomain(DomainStart=Slider(4.2, range=1..13), DomainEnd=Slider(1.2, range=0..2.02))
bnd_9 = Bounds(Numbers=graph_5)
prot_3 = RotatePlane(Plane=pt_7, Angle="0.5*pi")
remap_5 = RemapNumbers(Value=graph_5, Source=bnd_9, Target=dom_5)  # -> Mapped, Clipped
cir_3 = Circle(Plane=prot_3, Radius=remap_5.Mapped)
item_21 = ListItem(List=cir_3, Index=0, Wrap=True)
area_8 = Area(Geometry=item_21)  # -> Area, Centroid
number_slider_14 = Slider(0.01, range=0..1)
range_9 = Range(Domain=Domain(0, 1), Steps=Slider(8, range=0..50))
shatter_3 = Shatter(Curve=reparameterize(graft(cir_3)), Parameters=range_9)
subtraction_4 = Subtraction(A="1", B=number_slider_14)
merge_9 = Merge(Data1="0", Data2=number_slider_14, Data3=subtraction_4, Data4="1")
consec_3 = ConsecutiveDomains(Numbers=merge_9, Additive=invert(True))
panel_38 = Panel(merge_9)
subcrv_3 = SubCurve(BaseCurve=reparameterize(graft(shatter_3)), Domain=consec_3)
panel_39 = Panel("""0
2""")
panel_40 = Panel(consec_3)
cull_i_4 = CullIndex(List=subcrv_3, Indices=panel_39, Wrap=True)  # -> simplify(List)
item_22 = ListItem(List=subcrv_3, Index=panel_39, Wrap=True)
pshift_6 = ShiftPaths(Data=cull_i_4, Offset=-1)
flip_5 = FlipMatrix(Data=pshift_6)
midpt_3 = CurveMiddle(Curve=flip_5)
loft_7 = Loft(Curves=cir_3, Options={Adjust=False, Closed=False, LoftEnds=0, LoftSimp=0, LoftType=0, Rebuild=10, Refit=0.01})
pshift_7 = ShiftPaths(Data=item_22, Offset=-1)
graph_6 = GraphMapper(range_8, x0=0, x1=1, y0=0, y1=1, container_name="Bezier", cpx=[0, 0.25, 0.75, 1], cpy=[0, 0.25, 0.75, 1])
join_6 = JoinCurves(Curves=pshift_7, Preserve=False)
brep_cp_3 = BrepClosestPoint(Point=midpt_3, Brep=loft_7)  # -> Point, Normal, Distance
dom_6 = ConstructDomain(DomainStart=Slider(0.1, range=0..10), DomainEnd=Slider(0.11, range=0..1))
flip_6 = FlipMatrix(Data=join_6)
bnd_10 = Bounds(Numbers=graph_6)
remap_6 = RemapNumbers(Value=graph_6, Source=bnd_10, Target=dom_6)  # -> Mapped, Clipped
amp_3 = Amplitude(Vector=brep_cp_3.Normal, Amplitude=remap_6.Mapped)
rev_3 = Reverse(Vector=amp_3)
end_5 = EndPoints(Curve=flip_5)  # -> Start, End
move_4 = Move(Geometry=midpt_3, Motion=rev_3)  # -> Geometry, Transform
arc_3 = Arc3Pt(PointA=end_5.Start, PointB=move_4.Geometry, PointC=end_5.End)  # -> Arc, Plane, Radius
item_23 = ListItem(List=arc_3.Arc, Index=0, Wrap=True)
project_4 = Project(Geometry=item_23, Plane=PlaneXY(0, 0, 0))  # -> Geometry, Transform
loft_opt_3 = LoftOptions(Closed=False, Adjust=False, Rebuild=0, Refit="0.01", Type=0)
replace_3 = ReplaceItems(List=arc_3.Arc, Item=project_4.Geometry, Indices="0", Wrap=False)
loft_8 = Loft(Curves=flip_6, Options=loft_opt_3)
loft_9 = Loft(Curves=replace_3, Options=loft_opt_3)
entwine_7 = Entwine(Branch00=loft_9, Branch01=loft_8, FlattenInputs=True)
merge_10 = Merge(Data1=ColourSwatch(SwatchColor=RGBA(107, 107, 107, 206)), Data2=ColourSwatch(SwatchColor=RGB(255, 255, 255)))  # -> simplify(graft(Result))
python_3 = GhPythonScript(S=entwine_7, D=Slider(0.01, range=0..1))  # -> simplify(a); inputs S: Brep; same code as python
brep_11 = Brep(cap)
flatten_3 = FlattenTree(Tree=python_3, Path="{0}")

Z_5 = UnitZ(Factor=expr("-x", Slider(0.1, range=0..10)))
item_24 = ListItem(List=cir_3, Index="-1", Wrap=True)
extr_4 = Extrude(Base=item_24, Direction=Z_5)
cap_5 = CapHoles(Brep=extr_4)

item_25 = ListItem(List=flatten(brep_11), Index=0, Wrap=True)

volume_7 = Volume(Geometry=item_25)  # -> Volume, Centroid
move2pt_12 = MoveToPoint(Geometry=flatten_3, PointA=area_8.Centroid, PointB=graft(volume_7.Centroid))  # -> simplify(Moved), Vector, Transform
lng_3 = ListLength(List=move2pt_12.Moved)
graft_3 = GraftTree(Tree=volume_7.Centroid, IncludeEmptyLists=True, IncludeNullItems=True)  # -> simplify(Tree)
group_12 = Group(Objects=move2pt_12.Moved)
split_7 = SplitList(List=move2pt_12.Moved, Index=expr("x/2", lng_3))  # -> flatten(ListA), flatten(ListB)
mirror_3 = Mirror(Geometry=group_12, Plane=graft_3)  # -> Geometry, Transform
ungroup_3 = Ungroup(Group=mirror_3.Geometry)
move2pt_13 = MoveToPoint(Geometry=cap_5, PointA=area_8.Centroid, PointB=graft(volume_7.Centroid))  # -> Moved, Vector, Transform
entwine_8 = Entwine(Branch00=split_7.ListA, Branch01=split_7.ListB, FlattenInputs=True)  # -> simplify(Result)
split_8 = SplitList(List=ungroup_3, Index=expr("x/2", lng_3))  # -> flatten(ListA), flatten(ListB)
entwine_9 = Entwine(Branch00=split_8.ListA, Branch01=split_8.ListB, FlattenInputs=True)  # -> simplify(Result)
merge_11 = Merge(Data1=entwine_8, Data2=entwine_9)

volume_8 = Volume(Geometry=brep_11)  # -> Volume, Centroid
data_5 = Data([split_7.ListB, split_8.ListB])  # disabled
data_6 = Data([split_7.ListA, split_8.ListA])  # disabled
qrmesh_3 = QuadRemesh(Mesh=data_6, Settings={aqc=True, as=50, dhe=True, gci=0, null=False, pme=0, sa=0, tqc=2000})  # -> graft(QuadResult); disabled
qrmesh_4 = QuadRemesh(Mesh=data_5, Settings={aqc=True, as=50, dhe=True, gci=0, null=False, pme=0, sa=0, tqc=2000})  # disabled

# ---- group: units centroids
pt_8 = Point(flatten(volume_8.Centroid))  # disabled

# ---- group: unit centroid
pt_9 = Point(volume_7.Centroid)  # disabled

# ----
group_13 = Group(Objects=qrmesh_4)  # disabled
group_14 = Group(Objects=qrmesh_3)  # disabled
group_15 = Group(Objects=flatten([group_13, group_6]))  # disabled
move2pt_14 = MoveToPoint(Geometry=qrmesh_4, PointA=pt_9, PointB=graft(pt_8))  # -> flatten(Moved), Vector, Transform; disabled
move2pt_15 = MoveToPoint(Geometry=qrmesh_3, PointA=pt_9, PointB=pt_8)  # -> flatten(Moved), Vector, Transform; disabled
move2pt_16 = MoveToPoint(Geometry=[move2pt_13.Moved, qrmesh_4], PointA=pt_9, PointB=pt_8)  # -> flatten(Moved), Vector, Transform; disabled
merge_12 = Merge(Data1=move2pt_14.Moved, Data2=move2pt_16.Moved)  # disabled

filter_6 = StreamFilter(Gate=list_2, Stream1=[move2pt_15.Moved, move2pt_11.Moved, move2pt_6.Moved])
panel_41 = Panel("Inflatable")  # disabled
panel_42 = Panel("UNITS INFLATABLE")  # disabled
name_7 = ExtendSpeckleObject(
    SpeckleObject=filter_6,
    BIMSCPROJECT=bimsc_project,
    BIMSCORIGINATOR=bimsc_originator,
    BIMSCVOLUME=bimsc_volume,
    BIMSCLEVEL=floor_levels_6,
    BIMSCTYPE=panel_42,
    BIMSCMATERIAL=panel_41,
    RenderMaterial=dso.Insulation,
    BIMSCPHASE=num_5,
    selectedKitName="Objects")  # -> flatten(ExtendedSpeckleObject); disabled

# ----
# UNITS
filter_7 = StreamFilter(Gate=list_2, Stream1=[merge_12, merge_8, merge_4])
panel_43 = Panel("UNIT STRUCTURE")  # disabled
panel_44 = Panel("Steel")  # disabled
name_8 = ExtendSpeckleObject(
    SpeckleObject=filter_7,
    BIMSCPROJECT=bimsc_project,
    BIMSCORIGINATOR=bimsc_originator,
    BIMSCVOLUME=bimsc_volume,
    BIMSCLEVEL=floor_levels_5,
    BIMSCTYPE=panel_43,
    BIMSCMATERIAL=panel_44,
    RenderMaterial=dso.Steel,
    BIMSCPHASE=num,
    selectedKitName="Objects")  # -> flatten(ExtendedSpeckleObject); disabled

# ----
# 01 //Create Revit materials from Rhino M Properties
cset_3 = CreateSet(List=flatten(pshift))  # -> Set, Map
material = AddMaterial(Name=cset_3.Set, TrackingMode=2)  # disabled

# ---- group: MaterialProperties
python_4 = GhPythonScript(Mname=cset_3.Set)  # -> out, Pvalue, Pname
# ---------- python_4: Python ----------
__author__ = "hesham.shawqy"
__version__ = "2024.02.25"

import rhinoscriptsyntax as rs
import Rhino.DocObjects as rd
import Rhino as rh

def get_material_properties(Mname):
    # Get the active Rhino document
    doc = rh.RhinoDoc.ActiveDoc
    
    # Search for the material by name
    material_index = doc.Materials.Find(Mname, True)
    if material_index < 0:
        print("Material not found.")
        return None
    
    # Retrieve the material object
    material = doc.Materials[material_index]
    
    # Extract material properties
    properties = {
        "DiffuseColor": material.DiffuseColor,
        "Transparency": material.Transparency,
        # Add more properties as needed
    }
    
    return properties

Pname = []
Pvalue = []
material_properties = get_material_properties(Mname)
if material_properties:
    for prop, value in material_properties.items():
        Pvalue.append(value)
        Pname.append(prop)
# ---------- end python_4 ----------

# ----
item_26 = ListItem(List=simplify(python_4.Pvalue), Index=0, Wrap=True)  # -> Item, Item1
graphics = MaterialGraphics(
    Material=simplify(graft(material)),
    Color=item_26.Item,
    Transparency=item_26.Item1,
    ForegroundPatternCutPatterns=<geometry referenced from the Revit model>)  # -> Material, UseRenderAppearance, Color, Transparency, SurfacePatternsForegroundPattern, SurfacePatternsForegroundColor, CutPatternsForegroundPattern, CutPatternsForegroundColor; disabled

# ----
# SEND TO SPLECKLE STREAMS
# G6_STUDIO_MAIN_MODEL
# https://macad.speckle.xyz/streams/677b44128b
# G06_test_Unreal
# https://macad.speckle.xyz/streams/5e4e4e4563
# g06 wip branch
# https://macad.speckle.xyz/streams/4975f9f0a8/branches/wip%2Fg06
# g06 shared branch
# https://macad.speckle.xyz/streams/4975f9f0a8/branches/shared%2Fg06
panel_45 = Panel("G06_AssembledModel_V4")  # disabled
cso = CreateSpeckleObject(
    ROOF=name_4,
    WALL=name_5,
    FLOORS=name_2,
    PODS=name_3,
    UNITSINFLATABLES=name_7,
    UNITSTRUCTURE=name_8,
    TERRAIN=name,
    SITE_A4=name_6,
    selectedKitName="Objects")  # disabled

# ----
# Always Leave Send Component Unplugged
# in the stream input before closing and
# saving this gh file
send = Send(
    Message=panel_45,
    D=cso,
    AutoSend=False,
    BaseId="81f03236b71b13f63b781442c5bde320",
    CurrentComponentState="up_to_date",
    KitName="Objects",
    OutputWrappers="https://macad.speckle.xyz\t677b44128b\tcb70638a05",
    UseDefaultCache=True,
    selectedKitName="Objects")  # disabled

rec = DataRecorder(send, DataLimit=-10, RecordData=True)  # disabled
panel_46 = Panel(rec)  # disabled
